# Grasshopper definition DesignFacadesFromSections.gh (Grasshopper 1.0.7)
# plug-ins: Pufferfish

# Section Curves
crv = Curve([<curve referenced from the Rhino model> x3])
# Basecurve
crv_2 = Curve(reparameterize(<curve referenced from the Rhino model>))
end = EndPoints(Curve=crv)  # -> Start, End
pframe = PerpFrame(Curve=crv_2, Parameter=[Slider(1, range=0..1), Slider(0.25, range=0..1), Slider(0, range=0..1)])
orient = Orient(Geometry=crv, Source=end.Start, Target=pframe)  # -> Geometry, Transform
swp1 = Sweep1(Rail=crv_2, Sections=orient.Geometry, Miter=1)
number_slider = Slider(0.035, range=0..1)
multiplication = Multiplication(A=Slider(0.3, range=0..1), B="-1")
multiplication_2 = Multiplication(A=number_slider, B="-1")
# Offset (if needed)
offset = OffsetSurface(Surface=swp1, Distance=multiplication, Retrim=True)
offsrf = OffsetSurface(Surface=swp1, Distance=[number_slider, multiplication_2], BothSides=0, CreateSolid=True)
join = BrepJoin(Breps=offsrf)  # -> Breps, Closed
# Calculations
volume = Volume(Geometry=join.Breps)  # -> flatten(Volume), Centroid
ma = MassAddition(Input=volume.Volume)  # -> Result, PartialResults
panel = Panel(ma.Result)
multiplication_3 = Multiplication(A=panel, B="2.4")
panel_2 = Panel(multiplication_3)
multiplication_4 = Multiplication(A=panel_2, B="350")
panel_3 = Panel(multiplication_4)
