# Grasshopper definition MakeSurfaceFromMeshe.gh (Grasshopper 1.0.7)

# Mesh Input
mesh = Mesh(<mesh referenced from the Rhino model>)
bbox = BoundingBox(Content=mesh, Plane=PlaneXY(0, 0, 0))  # -> Box, Box_2
Y = UnitY(Factor=Slider(-2.57, range=-10..10))
move = Move(Geometry=bbox.Box, Motion=Y)  # -> Geometry, Transform
debrep = DeconstructBrep(Brep=move.Geometry)  # -> Faces, Edges, Vertices
number_slider = Slider(50, range=0..500)
item = ListItem(List=debrep.Faces, Index=0, Wrap=True)
area = Area(Geometry=item)  # -> Area, Centroid
scale = Scale(Geometry=item, Center=area.Centroid, Factor=Slider(0.97, range=0..1))  # -> Geometry, Transform
sdivide = DivideSurface(Surface=scale.Geometry, UCount=number_slider, VCount=Slider(50, range=0..500))  # -> Points, Normals, Parameters
Y_2 = UnitY(Factor=1)
addition = Addition(A=number_slider, B=Slider(1, range=0..20))
meshray = MeshRay(Mesh=mesh, Point=sdivide.Points, Direction=Y_2)  # -> flatten(Point), Hit
panel = Panel(meshray.Point)
srfgrid = SurfaceFromPoints(Points=meshray.Point, UCount=addition, Interpolate=False)
item_2 = ListItem(List=meshray.Point, Index=Slider(5379, range=0..10000), Wrap=True)
preview = CustomPreview(
    Geometry=srfgrid,
    Material={diffuse=RGB(221, 160, 221), emission=RGB(66, 48, 66), shine=0.5, specular=RGB(255, 255, 255), transparency=0})
