# Grasshopper definition start.gh (Grasshopper 1.0.7)
# plug-ins: ShapeDiverForGrasshopper, Pufferfish

sddp = ShapeDiverDocumentPayload({AbsoluteTolerance=0, AngleTolerance=0, DistanceDisplayPrecision=0, GltfVersion="Gltf2", GrasshopperVersion="1.0.0007", InputGroups="{}", OutputGroups="{}", RelativeTolerance=0, RhinoVersion="7.24.22308.15001", UnitSystem=0, VersionCreated="1.14.0.0", VersionSaved="1.14.0.0"})
line = Line(Line((0, 0.5, 0), (3, 0.5, 0)))
crv = Curve(<curve referenced from the Rhino model>)
crv_2 = Curve(<curve referenced from the Rhino model>)
crv_3 = Curve(<curve referenced from the Rhino model>)
Z = UnitZ(Factor="0")
move = Move(Geometry=line, Motion=Z)  # -> Geometry, Transform
crv_4 = Curve(reparameterize(<curve referenced from the Rhino model>))
crv_5 = Curve(<curve referenced from the Rhino model>)
end = EndPoints(Curve=crv_2)  # -> Start, End
end_2 = EndPoints(Curve=crv)  # -> Start, End
end_3 = EndPoints(Curve=crv_3)  # -> Start, End
reparamcrv = ReparameterizeCurve(Curve=crv_5)  # -> Reparameterized, Original
crv_6 = Curve(reparamcrv.Reparameterized)
len = Length(Curve=crv_6)
reparamcrv_2 = ReparameterizeCurve(Curve=crv_4)  # -> Reparameterized, Original
multiplication = Multiplication(A=len, B=Slider(0, range=0..1))
multiplication_2 = Multiplication(A=len, B=Slider(0.597, range=0..1))
multiplication_3 = Multiplication(A=len, B=Slider(0.097, range=0..1))
pframe = PerpFrame(Curve=crv_6, Parameter=multiplication_3)
pframe_2 = PerpFrame(Curve=crv_6, Parameter=multiplication)
pframe_3 = PerpFrame(Curve=crv_6, Parameter=multiplication_2)
orient = Orient(Geometry=crv_2, Source=end.Start, Target=pframe_3)  # -> Geometry, Transform
orient_2 = Orient(Geometry=crv, Source=end_2.Start, Target=pframe)  # -> Geometry, Transform
orient_3 = Orient(Geometry=crv_3, Source=end_3.Start, Target=pframe_2)  # -> Geometry, Transform
number_slider = Slider(0.036, range=0..1)
loft = Loft(
    Curves=[orient_3.Geometry, orient_2.Geometry, orient.Geometry],
    Options={Adjust=False, Closed=False, LoftEnds=0, LoftSimp=0, LoftType=0, Rebuild=10, Refit=0.01})
preview = CustomPreview(
    Geometry=loft,
    Material={diffuse=RGB(221, 160, 221), emission=RGB(66, 48, 66), shine=0.5, specular=RGB(255, 255, 255), transparency=0})
offsrf = OffsetSurface(Surface=loft, Distance=expr("-x", number_slider), BothSides=0, CreateSolid=True)
offsrf_2 = OffsetSurface(Surface=loft, Distance=number_slider, BothSides=0, CreateSolid=True)
pframe_4 = PerpFrame(Curve=reparamcrv_2.Reparameterized, Parameter=Slider(0.823, range=0..1))
pframe_5 = PerpFrame(Curve=reparamcrv_2.Reparameterized, Parameter=Slider(0, range=0..1))
pframe_6 = PerpFrame(Curve=reparamcrv_2.Reparameterized, Parameter=Slider(0.524, range=0..1))
pframe_7 = PerpFrame(Curve=reparamcrv_2.Reparameterized, Parameter=Slider(0.38, range=0..1))
pframe_8 = PerpFrame(Curve=reparamcrv_2.Reparameterized, Parameter=Slider(0.181, range=0..1))
pframe_9 = PerpFrame(Curve=reparamcrv_2.Reparameterized, Parameter=Slider(0.917, range=0..1))
pframe_10 = PerpFrame(Curve=reparamcrv_2.Reparameterized, Parameter=Slider(0.698, range=0..1))
pframe_11 = PerpFrame(Curve=reparamcrv_2.Reparameterized, Parameter=Slider(1, range=0..1))
join = BrepJoin(Breps=[offsrf_2, offsrf])  # -> Breps, Closed
volume = Volume(Geometry=join.Breps)  # -> Volume, Centroid
orient_4 = Orient(Geometry=crv, Source=end_2.Start, Target=pframe_6)  # -> Geometry, Transform
orient_5 = Orient(Geometry=crv_2, Source=end.Start, Target=pframe_4)  # -> Geometry, Transform
orient_6 = Orient(Geometry=crv, Source=end_2.Start, Target=pframe_10)  # -> Geometry, Transform
orient_7 = Orient(Geometry=crv_3, Source=end_3.Start, Target=pframe_5)  # -> Geometry, Transform
orient_8 = Orient(Geometry=crv, Source=end_2.Start, Target=pframe_7)  # -> Geometry, Transform
orient_9 = Orient(Geometry=crv, Source=end_2.Start, Target=pframe_8)  # -> Geometry, Transform
orient_10 = Orient(Geometry=crv_2, Source=end.Start, Target=pframe_9)  # -> Geometry, Transform
orient_11 = Orient(Geometry=crv_2, Source=end.Start, Target=pframe_11)  # -> Geometry, Transform
ma = MassAddition(Input=volume.Volume)  # -> Result, PartialResults
m3 = Panel(ma.Result)
panel = Panel("2.4")
loft_2 = Loft(
    Curves=[orient_7.Geometry, orient_9.Geometry, orient_8.Geometry, orient_4.Geometry, orient_6.Geometry, orient_5.Geometry, orient_10.Geometry, orient_11.Geometry],
    Options={Adjust=False, Closed=False, LoftEnds=0, LoftSimp=0, LoftType=0, Rebuild=10, Refit=0.01})
multiplication_4 = Multiplication(A=m3, B=panel)
t = Panel(multiplication_4)
euro = Panel("350")
srf = Surface(<surface referenced from the Rhino model>)
srf_2 = Surface(<surface referenced from the Rhino model>)
offsrf_3 = OffsetSurface(Surface=loft_2, Distance=expr("-x", number_slider), BothSides=0, CreateSolid=True)
offsrf_4 = OffsetSurface(Surface=loft_2, Distance=number_slider, BothSides=0, CreateSolid=True)
offsrf_5 = OffsetSurface(Surface=srf, Distance=expr("-x", number_slider), BothSides=0, CreateSolid=True)
multiplication_5 = Multiplication(A=t, B=euro)
offsrf_6 = OffsetSurface(Surface=srf, Distance=number_slider, BothSides=0, CreateSolid=True)
join_2 = BrepJoin(Breps=[offsrf_4, offsrf_3])  # -> Breps, Closed
euro_2 = Panel(multiplication_5)
join_3 = BrepJoin(Breps=[offsrf_6, offsrf_5])  # -> Breps, Closed
volume_2 = Volume(Geometry=join_2.Breps)  # -> Volume, Centroid
offsrf_7 = OffsetSurface(Surface=srf_2, Distance=expr("-x", number_slider), BothSides=0, CreateSolid=True)
offsrf_8 = OffsetSurface(Surface=srf_2, Distance=number_slider, BothSides=0, CreateSolid=True)
ma_2 = MassAddition(Input=volume_2.Volume)  # -> Result, PartialResults
join_4 = BrepJoin(Breps=[offsrf_8, offsrf_7])  # -> Breps, Closed
m3_2 = Panel(ma_2.Result)
panel_2 = Panel("2.4")
multiplication_6 = Multiplication(A=m3_2, B=panel_2)
t_2 = Panel(multiplication_6)
euro_3 = Panel("350")
multiplication_7 = Multiplication(A=t_2, B=euro_3)
euro_4 = Panel(multiplication_7)
